# Dynamo graph Import_excel.dyn (Dynamo 2.17.0.3472)

join = List.Join()  # unwired: list0, list1

# group: Revit側のパラメータ名に変更する
string = StringInput("IfcGUID")
string_2 = StringInput("レベル")
string_3 = StringInput("番号")
string_4 = StringInput("名前")
string_5 = StringInput("仕上表 仕上 壁")
string_6 = StringInput("仕上表 仕上 天井")
string_7 = StringInput("仕上表 仕上 床")
list_create = List.Create(item0=string, item1=string_2, item2=string_3, item3=string_4, item4=string_5, item5=string_6, item6=string_7)

file_path = Filename("..\..\..\..\Room-2023-08-14 (4).xlsx")
file_from_path = FileObject(path=file_path)
string_8 = StringInput("Tablib Dataset")
boolean = BoolSelector(false)
boolean_2 = BoolSelector(false)
importExcel = Data.ImportExcel(file=file_from_path, sheetName=string_8, readAsStrings=boolean, showExcel=boolean_2)
code_block = CodeBlock { 1; }
dropItems = List.DropItems(list=importExcel, amount=code_block)
transpose = List.Transpose(lists=dropItems)

# group: IfcGUID
code_block_2 = CodeBlock { 1; }
getItemAtIndex = List.GetItemAtIndex(list=transpose, index=code_block_2)
flatten = List.Flatten(list=getItemAtIndex)

# group: level
code_block_3 = CodeBlock { 2; }
getItemAtIndex_2 = List.GetItemAtIndex(list=transpose, index=code_block_3@L2)
flatten_2 = List.Flatten(list=getItemAtIndex_2)

string_from_object = FromObject(object=flatten_2)
code_block_4 = CodeBlock { -1; }
code_block_5 = CodeBlock { -7; }
remove = String.Remove(string=string_from_object, startIndex=code_block_4, count=code_block_5)

# group: レベル > レベルリスト
string_9 = StringInput("ピット")
string_10 = StringInput("1FL")
string_11 = StringInput("2FL")
string_12 = StringInput("3FL")
string_13 = StringInput("4FL")

# group: レベル
string_14 = StringInput("1")
replace = String.Replace(string=remove, searchFor=string_14, replaceWith=string_9)
string_15 = StringInput("2")
replace_2 = String.Replace(string=replace, searchFor=string_15, replaceWith=string_10)
string_16 = StringInput("3")
replace_3 = String.Replace(string=replace_2, searchFor=string_16, replaceWith=string_11)
string_17 = StringInput("4")
replace_4 = String.Replace(string=replace_3, searchFor=string_17, replaceWith=string_12)
string_18 = StringInput("5")
replace_5 = String.Replace(string=replace_4, searchFor=string_18, replaceWith=string_13)
string_19 = StringInput("6")
string_20 = StringInput("5FL")
replace_6 = String.Replace(string=replace_5, searchFor=string_19, replaceWith=string_20)
string_21 = StringInput("7")
string_22 = StringInput("6FL")
replace_7 = String.Replace(string=replace_6, searchFor=string_21, replaceWith=string_22)
string_23 = StringInput("8")
string_24 = StringInput("7FL")
replace_8 = String.Replace(string=replace_7, searchFor=string_23, replaceWith=string_24)
string_25 = StringInput("9")
string_26 = StringInput("RSL")

replace_9 = String.Replace(string=replace_8, searchFor=string_25, replaceWith=string_26)

# group: 番号
code_block_6 = CodeBlock { 3; }
getItemAtIndex_3 = List.GetItemAtIndex(list=transpose, index=code_block_6@L2)
flatten_3 = List.Flatten(list=getItemAtIndex_3)

# group: 名前
code_block_7 = CodeBlock { 4; }
getItemAtIndex_4 = List.GetItemAtIndex(list=transpose, index=code_block_7@L2)
flatten_4 = List.Flatten(list=getItemAtIndex_4)

# group: 壁仕上
code_block_8 = CodeBlock { 5; }
getItemAtIndex_5 = List.GetItemAtIndex(list=transpose, index=code_block_8@L2)
flatten_5 = List.Flatten(list=getItemAtIndex_5)
string_from_object_2 = FromObject(object=flatten_5)

code_block_9 = CodeBlock { -1; }
code_block_10 = CodeBlock { -7; }
remove_2 = String.Remove(string=string_from_object_2, startIndex=code_block_9, count=code_block_10)

# group: 壁仕上 > 壁仕上リスト
string_27 = StringInput("_")
string_28 = StringInput("EP-2")
string_29 = StringInput("素地")
string_30 = StringInput("化粧塩ビシート(A)")
string_31 = StringInput("花こう岩(A)")

# group: 壁仕上
string_32 = StringInput("1")
replace_10 = String.Replace(string=remove_2, searchFor=string_32, replaceWith=string_27)
string_33 = StringInput("2")
replace_11 = String.Replace(string=replace_10, searchFor=string_33, replaceWith=string_28)
string_34 = StringInput("3")
replace_12 = String.Replace(string=replace_11, searchFor=string_34, replaceWith=string_29)
string_35 = StringInput("4")
replace_13 = String.Replace(string=replace_12, searchFor=string_35, replaceWith=string_30)
string_36 = StringInput("5")
replace_14 = String.Replace(string=replace_13, searchFor=string_36, replaceWith=string_31)

# group: 天井仕上
code_block_11 = CodeBlock { 6; }
getItemAtIndex_6 = List.GetItemAtIndex(list=transpose, index=code_block_11@L2)
flatten_6 = List.Flatten(list=getItemAtIndex_6)
string_from_object_3 = FromObject(object=flatten_6)

code_block_12 = CodeBlock { -1; }
code_block_13 = CodeBlock { -7; }
remove_3 = String.Remove(string=string_from_object_3, startIndex=code_block_12, count=code_block_13)

# group: 天井仕上 > 天井仕上リスト
string_37 = StringInput("_")
string_38 = StringInput("岩綿吸音板(A)")
string_39 = StringInput("素地")
string_40 = StringInput("化粧GB(A)")
string_41 = StringInput("システム天井(A)")

# group: 天井仕上
string_42 = StringInput("1")
replace_15 = String.Replace(string=remove_3, searchFor=string_42, replaceWith=string_37)
string_43 = StringInput("2")
replace_16 = String.Replace(string=replace_15, searchFor=string_43, replaceWith=string_38)
string_44 = StringInput("3")
replace_17 = String.Replace(string=replace_16, searchFor=string_44, replaceWith=string_39)
string_45 = StringInput("4")
replace_18 = String.Replace(string=replace_17, searchFor=string_45, replaceWith=string_40)
string_46 = StringInput("5")
replace_19 = String.Replace(string=replace_18, searchFor=string_46, replaceWith=string_41)

# group: 床仕上
code_block_14 = CodeBlock { 7; }
getItemAtIndex_7 = List.GetItemAtIndex(list=transpose, index=code_block_14@L2)
flatten_7 = List.Flatten(list=getItemAtIndex_7)
string_from_object_4 = FromObject(object=flatten_7)

code_block_15 = CodeBlock { -1; }
code_block_16 = CodeBlock { -7; }
remove_4 = String.Remove(string=string_from_object_4, startIndex=code_block_15, count=code_block_16)

# group: 床仕上 > 床仕上リスト
string_47 = StringInput("_")
string_48 = StringInput("ビニル床シート(A)")
string_49 = StringInput("防塵塗装(A)")
string_50 = StringInput("ビニル床シート(B)")
string_51 = StringInput("花こう岩(A)")
string_52 = StringInput("素地")
string_53 = StringInput("タイルカーペット(A)")

# group: 床仕上
string_54 = StringInput("1")
replace_20 = String.Replace(string=remove_4, searchFor=string_54, replaceWith=string_47)
string_55 = StringInput("2")
replace_21 = String.Replace(string=replace_20, searchFor=string_55, replaceWith=string_48)
string_56 = StringInput("3")
replace_22 = String.Replace(string=replace_21, searchFor=string_56, replaceWith=string_49)
string_57 = StringInput("4")
replace_23 = String.Replace(string=replace_22, searchFor=string_57, replaceWith=string_50)
string_58 = StringInput("5")
replace_24 = String.Replace(string=replace_23, searchFor=string_58, replaceWith=string_51)
string_59 = StringInput("6")
replace_25 = String.Replace(string=replace_24, searchFor=string_59, replaceWith=string_52)
string_60 = StringInput("7")
replace_26 = String.Replace(string=replace_25, searchFor=string_60, replaceWith=string_53)

list_create_2 = List.Create(item0=flatten, item1=replace_9, item2=flatten_3, item3=flatten_4, item4=replace_14, item5=replace_19, item6=replace_26)
combine = List.Combine(combineFunction=join, list0=list_create, list1=list_create_2)
transpose_2 = List.Transpose(lists=combine)

# group: Excelに書き出し
file_path_2 = Filename("..\..\..\..\プロジェクト1\xlsx\部屋集計.xlsx")  # graph input
string_61 = StringInput("部屋集計")
code_block_17 = CodeBlock { 0; }
boolean_3 = BoolSelector(true)
boolean_4 = BoolSelector(true)
exportToExcel = Data.ExportToExcel(filePath=file_path_2, sheetName=string_61, startRow=code_block_17, startColumn=code_block_17, data=transpose_2, overWrite=boolean_3, writeAsString=boolean_4)  # frozen

# group: プロジェクト情報
code_block_18 = CodeBlock { 0; }
getItemAtIndex_8 = List.GetItemAtIndex(list=transpose, index=code_block_18)
string_from_object_5 = FromObject(object=getItemAtIndex_8)
flatten_8 = List.Flatten(list=string_from_object_5)
アプリ_pj情報__id = StringInput("1")  # graph input
revit_pj情報_設計番号 = StringInput("00001")  # graph input
replace_27 = String.Replace(string=flatten_8, searchFor=アプリ_pj情報__id, replaceWith=revit_pj情報_設計番号)

categories = Categories("OST_Rooms")
all_elements_of_category = ElementsOfCategory(Category=categories)
transpose_3 = List.Transpose(lists=list_create_2)
string_62 = StringInput("IfcGUID")
getParameterValueByName = Element.GetParameterValueByName(element=all_elements_of_category, parameterName=string_62)
sortByKey = List.SortByKey(list=transpose_3, keys=getParameterValueByName)
transpose_4 = List.Transpose(lists=sortByKey.sortedList)
code_block_19 = CodeBlock { 0; }
getItemAtIndex_9 = List.GetItemAtIndex(list=transpose_4, index=code_block_19)
setParameterByName = Element.SetParameterByName(element=all_elements_of_category, parameterName=string, value=getItemAtIndex_9)
code_block_20 = CodeBlock { 2; }
getItemAtIndex_10 = List.GetItemAtIndex(list=transpose_4, index=code_block_20)
setParameterByName_2 = Element.SetParameterByName(element=all_elements_of_category, parameterName=string_3, value=getItemAtIndex_10)
code_block_21 = CodeBlock { 3; }
getItemAtIndex_11 = List.GetItemAtIndex(list=transpose_4, index=code_block_21)
setParameterByName_3 = Element.SetParameterByName(element=all_elements_of_category, parameterName=string_4, value=getItemAtIndex_11)
code_block_22 = CodeBlock { 4; }
getItemAtIndex_12 = List.GetItemAtIndex(list=transpose_4, index=code_block_22)
setParameterByName_4 = Element.SetParameterByName(element=all_elements_of_category, parameterName=string_5, value=getItemAtIndex_12)
code_block_23 = CodeBlock { 5; }
getItemAtIndex_13 = List.GetItemAtIndex(list=transpose_4, index=code_block_23)
setParameterByName_5 = Element.SetParameterByName(element=all_elements_of_category, parameterName=string_6, value=getItemAtIndex_13)
code_block_24 = CodeBlock { 6; }
getItemAtIndex_14 = List.GetItemAtIndex(list=transpose_4, index=code_block_24)
setParameterByName_6 = Element.SetParameterByName(element=all_elements_of_category, parameterName=string_7, value=getItemAtIndex_14)
code_block_25 = CodeBlock { 1; }
dropItems_2 = List.DropItems(list=transpose_2, amount=code_block_25)
code_block_26 = CodeBlock { 0; }
getItemAtIndex_15 = List.GetItemAtIndex(list=transpose_2@L2, index=code_block_26)
